# Grasshopper definition BranchNodeRnd.ghx (Grasshopper 1.0.7)

# ---- group: RH_IN:201:Length
branch_length = Slider(0.74, range=0..10)

# ---- group: RH_IN:201:Radius
cell_radius = Slider(10, range=0..10)

# ---- group: RH_IN:201:Count
number_slider = Slider(35, range=1..100)

# ----
sph = Sphere(Base=PlaneXY(0, 0, 0), Radius=cell_radius)
popgeo = PopulateGeometry(Geometry=sph, Count=number_slider, Seed=1)
facet = FacetDome(Points=popgeo, Radius=cell_radius)  # -> Pattern, Dome
boundary = BoundarySurfaces(Edges=facet.Pattern)
pt = ConstructPoint(XCoordinate="0.5", YCoordinate="0.5", ZCoordinate=0)
evalsrf = EvaluateSurface(Surface=reparameterize(boundary), Point=pt)  # -> Point, Normal, UDirection, VDirection, Frame
deplane = DeconstructPlane(Plane=evalsrf.Frame)  # -> Origin, XAxis, YAxis, ZAxis
amp = Amplitude(Vector=deplane.ZAxis, Amplitude=branch_length)
extr = Extrude(Base=facet.Pattern, Direction=amp)
move = Move(Geometry=boundary, Motion=amp)  # -> Geometry, Transform
debrep = DeconstructBrep(Brep=extr)  # -> Faces, Edges, Vertices
debrep_2 = DeconstructBrep(Brep=debrep.Faces)  # -> Faces, Edges, Vertices
conmesh = ConstructMesh(Vertices=debrep_2.Vertices, Faces={A=0, B=1, C=2, D=3})  # -> flatten(Mesh)
mjoin = MeshJoin(Meshes=conmesh)
unim = UnifyMesh(Mesh=mjoin)  # -> Result, Count
demesh = DeconstructMesh(Mesh=unim.Result)  # -> Vertices, Faces, Colours, Normals
deface = DeconstructFace(Face=demesh.Faces)  # -> CornerA, CornerB, CornerC, CornerD
quad = MeshQuad(CornerA=deface.CornerD, CornerB=deface.CornerC, CornerC=deface.CornerB, CornerD=deface.CornerA)
conmesh_2 = ConstructMesh(Vertices=demesh.Vertices, Faces=quad)
mesh = Mesh(move.Geometry)
mjoin_2 = MeshJoin(Meshes=flatten([conmesh_2, mesh]))
unim_2 = UnifyMesh(Mesh=mjoin_2)  # -> Result, Count
medges = MeshEdges(Mesh=unim_2.Result)  # -> NakedEdges, InteriorEdges, NonManifoldEdges

# ---- group: RH_OUT:115:Mesh
mesh_2 = Mesh(unim_2.Result)

# ----
preview = CustomPreview(Geometry=mesh_2, Material=ColourSwatch(SwatchColor=RGB(255, 255, 255)))
